# Grasshopper definition ComposGH_Example_BS_01.gh (Grasshopper 1.0.7)
# Copyright: Arup
# plug-ins: Compos

number_slider = Slider(1800, range=0..10000)
profile = CreateProfile(
    NumberOfInputs=0,
    catalogueIndex=2,
    inclSS=False,
    lengthUnit="Centimeter",
    mode="Catalogue",
    Profile_type="Catalogue",
    Catalogue="British",
    Type="Wide flange beams(HE) - EN10365:2017",
    Profile="BSI-HE HE180AA",
    typeIndex=249)
support = RestraintSupport(SecMemIntermRes=True, FlngsFreeRotEnds=True, Intermediate_Sup="Mid-Span", Unit="Meter")
pt = ConstructPoint(XCoordinate=0, YCoordinate=0, ZCoordinate=0)
pt_2 = ConstructPoint(XCoordinate=0, YCoordinate=Slider(8, range=0..10), ZCoordinate=0)
ensteelmat = StandardEC4SteelMaterial(Grade="S275")
concmatbs = BSConcreteMaterial(ImposedLoadPercentage_=0.33, Grade="C70", Weight_Type="Normal", Density_Unit="KilogramPerCubicMeter")
restraints = Restraints(TopFlngLatResConstrStg=True, ConstructionStageSupport=support)
rad = Radians(Degrees="90")
ln = Line(StartPoint=pt, EndPoint=pt_2)
beamsection = BeamSection(BeamSection=profile, TaperNext=False, Unit="Meter")
deckconf = DeckConfig(Angle=rad, Discontinaus=Toggle(True), Welded=Toggle(False))
slabdimension = SlabDimension(
    OverallDepth_mm=Slider(165, range=0..1000),
    AvailableWidthLeft_mm=number_slider,
    AvailableWidthRight_mm=number_slider,
    Tapered=False,
    Unit="Millimeter")
rebarmat = RebarMaterial(Grade="BS_460T", Unit="Megapascal")
beam = CreateBeam(Line_m=ln, Restraint=restraints, Material=ensteelmat, BeamSections=beamsection, Unit="Meter")
stddeck = StandardDecking(DeckConfig=deckconf, Type="RLD", Decking="Ribdeck AL (0.9)", Steel_Type="S280")
meshr = MeshReinforcement(Cover_cm=Slider(2.5, range=0..10), Rotated=False, Standard_Mesh="A142", Unit="Centimeter")
transrb = TransverseReinforcement(Material=rebarmat)
stdstuddim = StandardStudDimensions(Standard_Size="Ø19/100mm")
studspecbs = StudBSSpecification(EC4Limit=True, Unit="Centimeter")
uniformload = CreateUniformLoad(
    ConstDead_kN_m²=Slider(1, range=0..10),
    ConstLive_kN_m²=Slider(1.5, range=0..10),
    FinalDead_kN_m²=Slider(1, range=0..10),
    FinalLive_kN_m²=Slider(5, range=0..10),
    Distribution="Area",
    Unit="KilonewtonPerSquareMeter")
slab = Slab(Material=concmatbs, Dimensions=slabdimension, TransverseReinforcement=transrb, MeshReinforcement=meshr, Decking=stddeck)
stud = CreateStud(StudDims=stdstuddim, StudSpec=studspecbs, Spacing_Type="Min Num of Studs")
dc = DesignCode(
    checkbox0=False,
    checkbox1=True,
    checkbox2=True,
    checkbox3=False,
    checkbox4=False,
    checkbox5=False,
    checkbox6=False,
    checkbox7=False,
    checkboxname0="Beam propped during construction",
    checkboxname1="Include steel beam weight",
    checkboxname2="Include thin-flange sections",
    checkboxname3="Include concrete slab weight",
    checkboxname4="Consider shear deflection",
    Code="BS5950-3.1:1990+A1:2010")
cat = SectionCataloguesID(Catalogue="Europrofile:EP HE beams")
member = CreateMember(Beam=beam, Stud=stud, Slab=slab, Loads=uniformload, DesignCode=dc, Name="MEMBER-1")
blm = BeamSizeLimit(
    MinDepth_m=Slider(0.2, range=0.2..1.5),
    MaxDepth_m=Slider(1, range=0.2..1.5),
    MinWidth_m=Slider(0.1, range=0.1..1.5),
    MaxWidth_m=Slider(0.5, range=0.2..1.5),
    Unit="Meter")
flm = FrequencyLimit(MinRequired_Hz=Slider(4, range=0..10), DeadLoadIncl=Slider(1, range=0..1), LiveLoadIncl=Slider(0.1, range=0..1))
dlm = DeflectionLimit(SpanDeflectionRatio_L_x=Slider(1000, range=0..1000), Unit="Millimeter")
dlm_2 = DeflectionLimit(SpanDeflectionRatio_L_x=Slider(200, range=0..1000), Unit="Millimeter")
save = SaveCompos(Member=member, Save=False)
crt = DesignCriteria(
    BeamSizeLimit=blm,
    CatalogueIDS=cat,
    ConstrDeadLoadLim=dlm,
    LiveLoadLim=dlm,
    TotalLoadLim=dlm_2,
    FrequencyLim=flm,
    Optimise_Option="Min. Height")
beamstress = BeamStressResults(Member=member, Load="Final", Stress_Unit="Megapascal", Length_Unit="Centimeter")  # -> TopFlange, Web, BottomFlange, Positions
mem = Member(member)
design = DesignMember(Member=mem, DesignCriteria=crt)
panel = Panel(beamstress.BottomFlange)

# ---- group: TEST01
code = CodeSatisfied(Member=mem)

# ---- group: TEST02
code_2 = CodeSatisfied(Member=design)

# ----
panel_2 = Panel(code_2)
panel_3 = Panel(code)
